# Grasshopper definition 10 Dome experiment.ghx (Grasshopper 1.0.8)
# plug-ins: Kangaroo2 Components

pt = Point(<point referenced from the Rhino model>)
number_slider = Slider(4216, range=3000..5000)
number_slider_2 = Slider(10, range=5..20)
number_slider_3 = Slider(10, range=5..20)
xy = XYPlane(Origin=pt)
Z = UnitZ(Factor="-1")
genes = GenePool(Decimals=0, Maximum=5000, Minimum=0, Value=[2500, 2500, 2500, 2500, 2500])
move = Move(Geometry=xy, Motion=Z)  # -> Geometry, Transform
msphere = MeshSphere(Base=xy, Radius=number_slider, UCount=number_slider_2, VCount=number_slider_3)
msplit = MeshSplitPlane(Mesh=msphere, Plane=move.Geometry)  # -> Above, Below
number_slider_4 = Slider(50, range=50..100)
pt_2 = Point([<point referenced from the Rhino model> x6])
medges = MeshEdges(Mesh=msplit.Above)  # -> NakedEdges, InteriorEdges, NonManifoldEdges
xy_2 = XYPlane(Origin=pt_2)
pipe = Pipe(Curve=medges.InteriorEdges, Radius=number_slider_4, Caps=0)
addition = Addition(A=number_slider, B=number_slider_4)
sphere = Sphere(Base=xy_2, Radius=genes)
construct_point = ConstructPoint(XCoordinate=0, YCoordinate=0, ZCoordinate=Slider(-1200, range=-1200..2000))
panel = Panel("C:\Users\xlydi\OneDrive\Documents\GitHub\Archipunk-Lydia-and-Freya\10 art.png")
cir = Circle(Plane=xy, Radius=addition)
sph = Sphere(Base=xy, Radius=addition)
msphere_2 = MeshSphere(Base=xy, Radius=addition, UCount=number_slider_2, VCount=number_slider_3)
solid_union = SolidUnion(Breps=sphere)
xy_plane = XYPlane(Origin=construct_point)
msplit_2 = MeshSplitPlane(Mesh=msphere_2, Plane=move.Geometry)  # -> Above, Below
srfsplit = SurfaceSplit(Surface=sph, Curves=cir)
brep_plane = BrepPlane(Brep=solid_union, Plane=xy_plane)  # -> Curves, Points
number_slider_5 = Slider(100, range=10..200)
crv = Curve(<curve referenced from the Rhino model>)
item = ListItem(List=srfsplit, Index="0", Wrap=True)
path = FilePath(panel)
split_brep = SplitBrep(Brep=solid_union)
faceb = FaceBoundaries(Mesh=msphere_2)
img = ImportImage(File=path, Rectangle=crv, XSamples=number_slider_5, YSamples=number_slider_5)

# ---- group: gradually increase this until circles are packed
number_slider_6 = Slider(1.258, range=0..20)

# ----
demesh = DeconstructMesh(Mesh=msplit_2.Above)  # -> Vertices, Faces, Colours, Normals
list_item = ListItem(List=split_brep, Index="0", Wrap=True)
panel_2 = Panel(demesh.Faces)
N = Count(1700)
mesh = Mesh(img)
item_2 = ListItem(List=demesh.Faces, Index="0", Wrap=True)
sdivide = DivideSurface(Surface=item, UCount=number_slider_5, VCount=number_slider_5)  # -> Points, Normals, Parameters
pop2d = Populate2D(Region=crv, Count=N, Seed=1)
triremesh = TriRemesh(Geometry=list_item, Length=Slider(29, range=0..500), Iterations=25)  # -> Triangulation, Dual, Creases
multiplication = Multiplication(A=Slider(10.792, range=1..100), B=number_slider_6)
multiplication_2 = Multiplication(A=Slider(72.317, range=1..100), B=number_slider_6)
imgcircles = ImageCircles(Points=pop2d, Mesh=mesh, Min=multiplication, Max=multiplication_2, Curves=crv, Strength=1)
list_item_2 = ListItem(List=sphere, Index=Slider(5, range=0..10), Wrap=True)
qrmesh = QuadRemesh(Mesh=triremesh.Triangulation, Settings={aqc=True, as=50, dhe=True, gci=0, null=False, pme=0, sa=0, tqc=2000})
mesh_2 = Mesh(triremesh.Triangulation)
mesh_3 = MeshBrep(
    Brep=item,
    Settings={GridMaxCount=0, GridMinCount=16, JaggedSeams=False, MaxEdgeLength=0, MinEdgeLength=0.0001, MinTolerance=0, Refine=True, RefineAngle=0, RelativeTolerance=0.65, SimplePlanes=True, Tolerance=0})
volume = Volume(Geometry=list_item_2)  # -> Volume, Centroid
solver = Solver(GoalObjects=imgcircles, Reset=Button(), Threshold=1e-15, Tolerance=0.01, On=Toggle(True))  # -> I, V, O
face_boundaries = FaceBoundaries(Mesh=qrmesh)
number_slider_7 = Slider(0.92, range=0..1)
number_slider_8 = Slider(0.58, range=0..1)
Z_2 = UnitZ(Factor=1)
polygon_center = PolygonCenter(Polyline=face_boundaries)  # -> CenterV, CenterE, CenterA
cir_2 = Circle(Plane=solver.V, Radius=solver.O)
neg = Negative(Value=Z_2)
distance = Distance(PointA=polygon_center.CenterV, PointB=volume.Centroid)
area = Area(Geometry=cir_2)  # -> Area, Centroid
meshray = MeshRay(Mesh=mesh_3, Point=area.Centroid, Direction=neg)  # -> Point, Hit
srf_cp = SurfaceClosestPoint(Point=meshray.Point, Surface=item)  # -> Point, UVPoint, Distance
construct_domain = ConstructDomain(DomainStart=number_slider_7, DomainEnd=number_slider_8)
bounds = Bounds(Numbers=distance)
evalsrf = EvaluateSurface(Surface=item, Point=srf_cp.UVPoint)  # -> Point, Normal, UDirection, VDirection, Frame
xy_3 = XYPlane(Origin=Point(0, 0, 0))
pl_origin = PlaneOrigin(Base=xy_3, Origin=area.Centroid)
orient = Orient(Geometry=cir_2, Source=pl_origin, Target=evalsrf.Frame)  # -> Geometry, Transform
remap_numbers = RemapNumbers(Value=distance, Source=bounds, Target=construct_domain)  # -> Mapped, Clipped
pull = PullCurve(Curve=orient.Geometry, Surface=item)
scale = Scale(Geometry=face_boundaries, Center=polygon_center.CenterV, Factor=remap_numbers.Mapped)  # -> Geometry, Transform
gradient = Gradient(
    LowerLimit=number_slider_7,
    UpperLimit=number_slider_8,
    Parameter=remap_numbers.Mapped,
    stops=[0.15: RGB(255, 130, 160), 0.85: RGB(220, 0, 40)])
ruled_surface = RuledSurface(CurveA=face_boundaries, CurveB=scale.Geometry)
custom_preview = CustomPreview(Geometry=ruled_surface, Material=gradient)
