# Grasshopper definition Week 5 - Clock Face.ghx (Grasshopper 1.0.8)

number_slider = Slider(6, range=0..100)
radius = Slider(10, range=0..10)
division = Division(A=radius, B=Slider(1.053, range=0..10))
pi = Pi(Factor="2")
modulus = Modulus(A=number_slider, B=Slider(9, range=0..100))
circle = Circle(Plane=PlaneXY(0, 0, 0), Radius=radius)
construct_point = ConstructPoint(XCoordinate="0", YCoordinate="0", ZCoordinate="0")
circle_2 = Circle(Plane=PlaneXY(0, 0, 0), Radius=division)
addition = Addition(A=number_slider, B=modulus)
integer = Integer(addition)
division_2 = Division(A=pi, B="60")
divide_curve = DivideCurve(Curve=circle, Count=addition, Kinks=False)  # -> Points, Tangents, Parameters
degrees = Degrees(Radians=division_2)
pi_2 = Pi(Factor=2)
division_3 = Division(A=pi_2, B=addition)
trigger = Trigger(Interval=1000, TimerInterval=1000, Target=data_recorder)
multiplication = Multiplication(A="60", B="12")
dispatch = Dispatch(List=divide_curve.Points, DispatchPattern=[True, False])  # -> ListA, ListB
multiplication_2 = Multiplication(A=degrees, B=Slider(3102, range=0..4000))
data_recorder = DataRecorder(degrees, DataLimit=-10, RecordData=True)  # disabled
division_4 = Division(A=data_recorder, B="60")
division_5 = Division(A=data_recorder, B=multiplication)
mass_addition = MassAddition(Input=division_4)  # -> Result, PartialResults
mass_addition_2 = MassAddition(Input=division_5)  # -> Result, PartialResults
line = Line(StartPoint=dispatch.ListA, EndPoint=dispatch.ListB)
mass_addition_3 = MassAddition(Input=data_recorder)  # -> Result, PartialResults
multiplication_3 = Multiplication(A=mass_addition.Result, B="-1")
multiplication_4 = Multiplication(A=mass_addition_2.Result, B="-1")
unit_z = UnitZ(Factor=1)
pi_3 = Pi(Factor=-0.5)
vector = Vector(line)
concatenate = Concatenate(FragmentA=mass_addition_3.Result, FragmentB="deg.")
multiplication_5 = Multiplication(A=mass_addition_3.Result, B="-1")
rotate = Rotate(Vector=vector, Axis=unit_z, Angle=pi_3)
panel = Panel(concatenate)
amplitude = Amplitude(Vector=rotate, Amplitude=Slider(3, range=0..10))
point_polar = PointPolar(BasePlane=construct_point, XYAngle=expr("x+90", degrees(multiplication_5)), ZAngle=0, Offset=Slider(9, range=0..100))
point_polar_2 = PointPolar(BasePlane=construct_point, XYAngle=expr("x+90", degrees(multiplication_3)), ZAngle=0, Offset=Slider(8, range=0..100))
point_polar_3 = PointPolar(BasePlane=construct_point, XYAngle=expr("x+90", degrees(multiplication_4)), ZAngle=0, Offset=Slider(5, range=0..100))
panel_2 = Panel(mass_addition_3.Result)
move = Move(Geometry=line, Motion=amplitude)  # -> Geometry, Transform
line_2 = Line(StartPoint=construct_point, EndPoint=point_polar)
line_3 = Line(StartPoint=construct_point, EndPoint=point_polar_2)
curve = Curve(line)
line_4 = Line(StartPoint=construct_point, EndPoint=point_polar_3)
evaluate_length = EvaluateLength(Curve=move.Geometry, Length=0.5, Normalized=True)  # -> Point, Tangent, Parameter
number_slider_2 = Slider(0.45, range=0..1)
list_length = ListLength(List=line_2)
evaluate_length_2 = EvaluateLength(Curve=curve, Length=0.5, Normalized=True)  # -> Point, Tangent, Parameter
multiplication_6 = Multiplication(A=list_length, B=Slider(10.286, range=0..100))
circle_3 = Circle(Plane=construct_point, Radius=multiplication_6)
division_6 = Division(A="1", B=number_slider_2)
scale = Scale(Geometry=move.Geometry, Center=evaluate_length.Point, Factor=number_slider_2)  # -> Geometry, Transform
scale_2 = Scale(Geometry=curve, Center=evaluate_length_2.Point, Factor=division_6)  # -> Geometry, Transform
divide_curve_2 = DivideCurve(Curve=circle_3, Count=Slider(12, range=0..100), Kinks=False)  # -> Points, Tangents, Parameters
shift_list = ShiftList(List=scale_2.Geometry, Shift=1, Wrap=True)
end_points = EndPoints(Curve=scale_2.Geometry)  # -> Start, End
end_points_2 = EndPoints(Curve=scale.Geometry)  # -> Start, End
shatter = Shatter(Curve=circle_3, Parameters=divide_curve_2.Parameters)
panel_3 = Panel(divide_curve_2.Parameters)
shift_list_2 = ShiftList(List=reverse(divide_curve_2.Points), Shift="-3", Wrap=True)
end_points_3 = EndPoints(Curve=shift_list)  # -> Start, End
scale_3 = Scale(Geometry=shift_list_2, Center=construct_point, Factor=Slider(0.82, range=0..10))  # -> Geometry, Transform
construct_domain = ConstructDomain(DomainStart="1", DomainEnd="12")
line_5 = Line(StartPoint=end_points_2.Start, EndPoint=end_points.Start)
line_6 = Line(StartPoint=end_points_2.End, EndPoint=end_points.End)
divide_curve_3 = DivideCurve(Curve=shatter, Count="5", Kinks=False)  # -> Points, Tangents, Parameters
shatter_2 = Shatter(Curve=circle_3, Parameters=flatten(divide_curve_3.Parameters))
list_item = ListItem(List=graft(shatter_2), Index=0, Wrap=True)
panel_4 = Panel("""false
true
true
true
true""")
line_7 = Line(StartPoint=end_points.End, EndPoint=end_points_3.Start)
divide_curve_4 = DivideCurve(Curve=list_item, Count="60", Kinks=False)  # -> Points, Tangents, Parameters
range = Range(Domain=construct_domain, Steps=expr("x-1", "12"))
dispatch_2 = Dispatch(List=divide_curve_3.Points, DispatchPattern=panel_4)  # -> ListA, ListB
merge = Merge(Data1=scale.Geometry, Data2=line_5, Data3=line_6, Data4=line_7)  # -> flatten(Result)
text_tag_3d = TextTag3D(Location=shift_list_2, Text=range, Size=Slider(1.09, range=0..10), Justification=5)
number = Number(division_3)
join_curves = JoinCurves(Curves=merge, Preserve=False)
division_7 = Division(A=number, B=2)
point = Point(dispatch_2.ListB)
curve_2 = Curve(circle_2)
point_2 = Point(dispatch_2.ListA)
move_2 = Move(Geometry=curve_2, Motion=Vector(0, 0, 10))  # -> Geometry, Transform
scale_4 = Scale(Geometry=point_2, Center=construct_point, Factor=Slider(0.92, range=0..1))  # -> Geometry, Transform
scale_5 = Scale(Geometry=point, Center=construct_point, Factor=Slider(0.922, range=0..1))  # -> Geometry, Transform
rotate_2 = Rotate(Geometry=join_curves, Angle=division_7, Plane=PlaneXY(0, 0, 0))  # -> Geometry, Transform
line_8 = Line(StartPoint=point_2, EndPoint=scale_4.Geometry)
line_9 = Line(StartPoint=point, EndPoint=scale_5.Geometry)
number_2 = Number(Slider(60, range=0..100))
unit_x = UnitX(Factor=Slider(0, range=0..100))
radians = Radians(Degrees=number_2)
rotate_3 = Rotate(Geometry=rotate_2.Geometry, Angle=radians, Plane=PlaneXY(0, 0, 0))  # -> Geometry, Transform
move_3 = Move(Geometry=[circle_2, rotate_3.Geometry], Motion=unit_x)  # -> Geometry, Transform
curve_3 = Curve(rotate_3.Geometry)
area = Area(Geometry=curve_3)  # -> Area, Centroid
rotate_4 = Rotate(Geometry=curve_3, Angle=degrees(1.570796327), Plane=area.Centroid)  # -> Geometry, Transform
